# Grasshopper definition PolarTest.gh (Grasshopper 1.0.7)

motor_distance = Slider(2000, range=0..2000)
cable_1_length = Slider(1500, range=0..2000)
cable_2_length = Slider(1500, range=0..2000)
expression = Expression(r1="1500", r2="1500", d="2000", Expression="(r1 * r1 - r2 * r2 + d * d)/ (2 * d)")
expression_2 = Expression(r1="1500", x=expression, Expression="-Sqrt(r1 * r1 - x * x)")
pt = ConstructPoint(XCoordinate=0, YCoordinate=0, ZCoordinate=0)
pt_2 = ConstructPoint(XCoordinate=motor_distance, YCoordinate=0, ZCoordinate=0)
pt_3 = ConstructPoint(XCoordinate=expression, YCoordinate=expression_2, ZCoordinate=0)
vec = VectorXYZ(XComponent=Slider(-174, range=-500..500), YComponent=Slider(-458, range=-500..500), ZComponent=0)  # -> Vector, Length
one_over_x = OneOverX(Value=motor_distance)
addition = Addition(A=pt_3, B=vec.Vector)
ln = Line(StartPoint=pt, EndPoint=addition)
ln_2 = Line(StartPoint=pt_2, EndPoint=addition)
len = Length(Curve=ln_2)
cir = Circle(Plane=pt_2, Radius=len)
len_2 = Length(Curve=ln)
expression_3 = Expression(r1=len_2, r2=len, d=motor_distance, Expression="(r1 * r1 - r2 * r2 + d * d)/ (2 * d)")
expression_4 = Expression(r1=len_2, x=expression_3, Expression="-Sqrt(r1 * r1 - x * x)")
# Calculate xy position based on cable length
cir_2 = Circle(Plane=pt, Radius=len_2)
vec_2 = VectorXYZ(XComponent=expression_3, YComponent=expression_4, ZComponent=0)  # -> Vector, Length
subtraction = Subtraction(A=pt_3, B=vec_2.Vector)
multiplication = Multiplication(A=one_over_x, B=vec_2.Vector)
addition_2 = Addition(A=pt, B=vec_2.Vector)
panel = Panel(subtraction)
panel_2 = Panel([len_2, len])
panel_3 = Panel(multiplication)
ln_3 = Line(StartPoint=[pt, pt_2], EndPoint=addition_2)
